# Grasshopper definition HelloWorld.gh (Grasshopper 1.0.7)
# plug-ins: ScriptParasite

# Step 1: Double click this yellow panel
# and paste the path to your folder here
# Step 2: Set this toggle to True by double click
# Step 3: Check if a script named "HelloWorld-xxxxx.cs"
# appears in your folder, open it with Visual Studio Code (VSC)
# Step 4: Modify "hello, world" at line 57 in VSC to display other words
# Step 5: Use the sliders below to change the position
number_slider = Slider(0, range=0..10)
pt = ConstructPoint(XCoordinate=number_slider, YCoordinate=Slider(0, range=0..10), ZCoordinate=Slider(0, range=0..10))

helloworld = CSharpScript()  # -> Text
# ---------- helloworld: C# ----------
    Text = "hello, world";
# ---------- end helloworld ----------
scriptpar = ScriptParasite(Enable=Toggle(False))

tag = TextTag(Location=pt, Text=helloworld)
