# Grasshopper definition Filter.gh (Grasshopper 1.0.7)
# plug-ins: ScriptParasite

number_slider = Slider(12, range=0..100)
srf = Surface(reparameterize(<surface referenced from the Rhino model>))
sdivide = DivideSurface(Surface=srf, UCount=number_slider, VCount=number_slider)  # -> Points, Normals, simplify(Parameters)
number_slider_2 = Slider(10, range=0..100)
image = ImageSampler(
    sdivide.Parameters,
    FilePath="C:\Users\xdd44\Dropbox (MIT)\IAP\2\PM.png",
    Filter="Value",
    Interpolate=False,
    Umax=1,
    Umin=0,
    Vmax=1,
    Vmin=0,
    Wrap=1)
sort = SortList(Keys=flatten(image))  # -> Keys, ValuesA
item = ListItem(List=sort.Keys, Index=0, Wrap=True)
item_2 = ListItem(List=sort.Keys, Index=-1, Wrap=True)
dom = ConstructDomain(DomainStart=item, DomainEnd=item_2)
dom_2 = ConstructDomain(DomainStart=Slider(0, range=0..100), DomainEnd=Slider(10, range=0..100))

# ---- group: Generate a Gaussian Filter
sigma = Slider(0.6, range=0..5)
genfilter = CSharpScript(size=Slider(3, range=1..15), sigma=sigma)  # -> filter; inputs size: Int32, sigma: Double
# ---------- genfilter: C# ----------
    if (size % 2 == 0) {
      size -= 1;
    }
    if (size < 1) {
      return;
    }
    DataTree<double> result = new DataTree<double>();
    double c = (size - 1) / 2;
    double sum = 0;
    for (int i = 0;i < size;i++) {
      for (int j = 0;j < size;j++) {
        double value = Math.Exp(-((c - i) * (c - i) + (c - j) * (c - j)) / (2 * sigma * sigma)) / (2 * Math.PI * sigma * sigma);
        sum += value;
        result.Add(value,new GH_Path(i));
      }
    }
    for (int i = 0;i < size;i++) {
      for (int j = 0;j < size;j++) {
        result[new GH_Path(i), j] /= sum;
      }
    }
    filter = result;
# ---------- end genfilter ----------

# ----
remap = RemapNumbers(Value=image, Source=dom, Target=dom_2)  # -> Mapped, Clipped

applyfilter = CSharpScript(Image=remap.Mapped, Filter=genfilter)  # -> Result; inputs Image: tree of Double, Filter: tree of Double
# ---------- applyfilter: C# ----------
    List<List<double>> imageList = new List<List<double>>();
    List<List<double>> filterList = new List<List<double>>();

    int size = Image.BranchCount;
    int filterSize = Filter.BranchCount;

    for (int i=0;i<size;i++) {
      imageList.Add(Image.Branches[i]);
    }
    for (int i=0;i<filterSize;i++) {
      filterList.Add(Filter.Branches[i]);
    }

    DataTree<double> resultTree = new DataTree<double>();

    for (int x=0;x<size;x++) {
      for (int y=0;y<size;y++) {
        double resultValue = 0;
        for (int i=0;i<filterSize;i++) {
          for (int j=0;j<filterSize;j++) {
            if (
              x + i - filterSize / 2 >= 0 &&
              x + i - filterSize / 2 < size &&
              y + j - filterSize / 2 >= 0 &&
              y + j - filterSize / 2 < size
            ) {
              resultValue += imageList[x + i - filterSize / 2][y + j - filterSize / 2] * filterList[i][j];
            }
          }
        }
        resultTree.Add(resultValue, new GH_Path(x));
      }
    }

    Result = resultTree;
# ---------- end applyfilter ----------
scriptpar = ScriptParasite(Enable=Toggle(True), Folder="C:\Users\xdd44\Dropbox (MIT)\IAP\2\Scripts")

sph = Sphere(Base=sdivide.Points, Radius=applyfilter)
preview = CustomPreview(
    Geometry=sph,
    Material={diffuse=RGB(221, 160, 221), emission=RGB(66, 48, 66), shine=0.5, specular=RGB(255, 255, 255), transparency=0})
panel = Panel(applyfilter)
