# Grasshopper definition Spiral.gh (Grasshopper 1.0.7)
# plug-ins: ScriptParasite

panel = Panel()
pt = ConstructPoint(XCoordinate=0, YCoordinate=0, ZCoordinate=0)

goldenspiral = CSharpScript(pos=pt, size=Slider(1, range=0..1), n=Slider(16, range=0..25))  # -> result; inputs pos: Point3d, size: Double, n: Int32
# ---------- goldenspiral: C# ----------
    List<Arc> arcs = new List<Arc>();

    //Construct the first two arcs
    int prev1 = 1;
    Arc arc1 = new Arc(pos, size * prev1, Math.PI / 2);
    arc1.StartAngle = 0;
    arc1.EndAngle = Math.PI / 2;
    arcs.Add(arc1);
    
    int prev2 = 1;
    Arc arc2 = new Arc(pos, size * prev2, Math.PI / 2);
    arc2.StartAngle = Math.PI / 2;
    arc2.EndAngle = Math.PI;
    arcs.Add(arc2);

    //Initialize arc center
    Point3d center = pos;

    for (int i=2;i<n;i++) {
      //Current Fibonacci value
      int value = prev1 + prev2;
      //Distance to move arc center
      Vector3d offset = new Vector3d(prev1 * size, 0, 0);
      //Direction to move arc center
      offset.Rotate(Math.PI / 2 * (i - 2), new Vector3d(0, 0, 1));
      //Move arc center
      center += offset;
      //Construct arc
      Arc arc = new Arc(center, size * value, Math.PI / 2);
      //Correct arc start & end position
      arc.StartAngle = Math.PI / 2 * i;
      arc.EndAngle = Math.PI / 2 * (i + 1);
      //Add to output list
      arcs.Add(arc);
      //Update previous values for next round
      prev1 = prev2;
      prev2 = value;
    }

    result = arcs;
# ---------- end goldenspiral ----------
scriptpar = ScriptParasite(Enable=Toggle(False), Folder=panel)

pipe = Pipe(Curve=goldenspiral, Radius=Slider(5, range=0..10), Caps=0)
preview = CustomPreview(
    Geometry=pipe,
    Material={diffuse=RGB(228, 178, 227), emission=RGB(68, 53, 68), shine=0.5, specular=RGB(255, 254, 254), transparency=0})
