# Grasshopper definition BinPacking_Review.gh (Grasshopper 1.0.7)

module_counts = Panel("""500
500
500
500""")
# How does it work without the multiple of modules. Can we split and adapt the script in that way
module_types = Panel("""1 1
1 4
2 4
3 4""")
grid_size = Panel("0.75")
brick_orientation_landscape_portrait = BooleanToggle(True)
# Better NOT to use Geometry Pipleline since one iteration may take 10 seconds.
pipeline = GeometryPipeline(
    GroupByLayer=False,
    GroupByType=False,
    IncludeHidden=True,
    IncludeLocked=True,
    LayerFilter="Surfaces",
    NameFilter="*",
    SublayerFiltering=True,
    TypeFilter=1073741848)
grid_size_2 = Panel("0.75")
module_types_2 = Panel("""1 2
1 3
2 2
2 3
2 4
3 4
2 6
3 6""")
brick_orientation_landscape_portrait_2 = BooleanToggle(True)
# This part generates point grids from arbitrary planar surfaces.
# 
# Target/Source planes provides orientation info.
# 
# Potential improvement: calculate and output 2D array in code instead of physically generating points
debrep = DeconstructBrep(Brep=pipeline)  # -> Faces, Edges, Vertices
genes = GenePool(Decimals=2, Maximum=1, Minimum=0, Value=[0.54, 0.46, 0.44, 0.39, 0.32, 0.29, 0.28, 0.27])
gridgenerator = GridGenerator(surface=debrep.Faces, gridsize=grid_size)  # -> centers, simplify(target_plane_2), source_plane_2

# ----
# This algorithm supports point grid (with missing points???), and the tiles will not cover positions without points. Check the example by feeding these points in PointGrid parameter.
# 
# The provided grid generator will generate point grid that covers the bounding box instead of the actual shape. If most surfaces are in irregular shape or have holes, it is suggested to generate point grid based on actual shape
# This algorithm supports point grid with missing points, and the tiles will not cover positions without points. Check the example by feeding these points in PointGrid parameter.
# 
# The provided grid generator will generate point grid that covers the bounding box instead of the actual shape. If most surfaces are in irregular shape or have holes, it is suggested to generate point grid based on actual shape
example_point_grid = Point([Point(0, 0, 0), Point(0.75, 0, 0), Point(1.5, 0, 0), Point(2.25, 0, 0), Point(3, 0, 0), Point(3.75, 0, 0)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])

panelizationpercentage = CSharpScript(
    ModuleDimensions=module_types_2,
    ModulePercentages=genes,
    GridSize=grid_size_2,
    PointGrid=gridgenerator.centers,
    Seed=Slider(16, range=0..100),
    FreeOrientation=brick_orientation_landscape_portrait_2,
    Gradient=Slider(2, range=0..4))  # -> simplify(Result), Leftovers, Debug; inputs ModuleDimensions: list of String, ModulePercentages: list of Double, GridSize: Double, PointGrid: list of Point3d, Seed: Int32, FreeOrientation: Boolean, Gradient: Double
# ---------- panelizationpercentage: C# usings ----------
using System.Linq;
# ---------- panelizationpercentage: C# ----------
    rnd = new Random(Seed);
    moduleDimensions = ModuleDimensions;
    modulePercentages = ModulePercentages;
    gridSize = GridSize;
    pointGrid = PointGrid;
    freeOrientation = FreeOrientation;
    grad = Gradient;
    debug = new List<string>();

    initializeArrays();

    convertGrid();
    calculateOptions();
    initializePositionQueue();
    process();

    List<string> leftovers = new List<string>();
    for (int i = 0; i < options.Count - 1; i++) {
      leftovers.Add(options[i].n + " pieces remaining for " + options[i].w + " x " + options[i].h);
    }

    Result = curves;
    Leftovers = leftovers;
    Debug = debug;
# ---------- panelizationpercentage: C# additional code ----------
  static Random rnd = new Random(5000);

  //Input info
  private List<string> moduleDimensions;
  private List<double> modulePercentages;
  private double gridSize;
  private List<Point3d> pointGrid;
  private bool freeOrientation;
  private double grad;

  //Dimension of wall
  private int width;
  private int height;
  //Dimension in real coordinates
  private double minX;
  private double minY;
  private double maxX;
  private double maxY;
  //Whether a unit has been covered
  private List<List<bool>> map = new List<List<bool>>();
  //Result denoted by #option for debug
  private List<List<int>> result = new List<List<int>>();
  //Queue storing available positions for process
  private Queue<Position> available = new Queue<Position>();
  //Brick option (width, height, count)
  private List<Option> options = new List<Option>();
  //Final curves
  private List<Curve> curves = new List<Curve>();
  private int total = 1;
  public List<string> debug;

  public class Option {
    public int w;
    public int h;
    public int n;
    public Option(int w, int h) {
      this.w = w;
      this.h = h;
      this.n = 0;
    }
    public Option(int w, int h, int n) {
      this.w = w;
      this.h = h;
      this.n = n;
    }
    public void rotate() {
      int t = w;
      w = h;
      h = t;
    }
  }
  public class Position {
    public int x;
    public int y;
    public Position(int x, int y) {
      this.x = x;
      this.y = y;
    }
  }

  private void initializeArrays() {
    map = new List<List<bool>>();
    result = new List<List<int>>();
    available = new Queue<Position>();
    options = new List<Option>();
    curves = new List<Curve>();
  }

  private void convertGrid() {

    minX = pointGrid.Min(p => p.X);
    maxX = pointGrid.Max(p => p.X);
    minY = pointGrid.Min(p => p.Y);
    maxY = pointGrid.Max(p => p.Y);
    width = (int) Math.Round((maxX - minX) / gridSize) + 1;
    height = (int) Math.Round((maxY - minY) / gridSize) + 1;

    for (int i = 0; i < width; i++)
    {
      map.Add(new List<bool>());
      result.Add(new List<int>());
      for (int j = 0; j < height; j++)
      {
        map[i].Add(false);
        result[i].Add(0);
      }
    }
    foreach (Point3d p in pointGrid) {
      map[(int) Math.Round((p.X - minX) / gridSize)][(int) Math.Round((p.Y - minY) / gridSize)] = true;
    }

  }

  private void calculateOptions() {
    //Calculate brick counts by area if not given
    options = new List<Option>();
    foreach (string optionString in moduleDimensions) {
      string[] optionDim = optionString.Split(' ');
      options.Add(new Option(Int32.Parse(optionDim[0]), Int32.Parse(optionDim[1])));
    }
    if (modulePercentages == null || modulePercentages.Count < moduleDimensions.Count) {
      for (int i = 0;i < moduleDimensions.Count;i++) {
        modulePercentages.Add(1);
      }
    }
    int totalArea = width * height;
    for (int i = 0; i < options.Count;i++) {
      options[i].n = (int) (totalArea * 0.96 * modulePercentages[i] / modulePercentages.Sum() / (options[i].w * options[i].h));
    }
    options.Sort((x, y) => y.w * y.h - x.w * x.h);
    options.Add(new Option(1, 1, 2147483647));
  }

  private void initializePositionQueue() {
    List <Position> positions = new List<Position>();
    for (int i = 0; i < height; i++) {
      for (int j = 0; j < width; j++) {
        if (map[j][i]) {
          positions.Add(new Position(j, i));
        }
      }
    }
    positions = positions.OrderBy(p => p.y).ToList();

    // Shuffle the available positions;
    for (int i = 0; i < positions.Count - 2; i++) {
      int j = i + nonUniformRand(positions.Count - i);
      Position t = positions[j];
      positions[j] = positions[i];
      positions[i] = t;
    }
    for (int i = 0;i < positions.Count;i++) {
      available.Enqueue(positions[i]);
    }
  }

  private void process() {
    for (int currentOption = 0; currentOption < options.Count; currentOption++) {
      int availableCount = available.Count;
      //For each brick option, only need to test each position once
      for (int t = 0; t < availableCount && options[currentOption].n > 0; t++) {
        Position testPosition = available.Dequeue();
        //Dispose the position if it's already covered
        if (map[testPosition.x][testPosition.y]) {
          if (freeOrientation && rnd.Next() % 2 == 0) {
            options[currentOption].rotate();
          }
          if (fitBrick(testPosition.x, testPosition.y, options[currentOption].w, options[currentOption].h)) {
            options[currentOption].n--;
          }
          else if (freeOrientation && fitBrick(testPosition.x, testPosition.y, options[currentOption].h, options[currentOption].w)) {
            options[currentOption].n--;
          }
          else {
            available.Enqueue(testPosition);
          }
        }
      }
    }
  }

  private bool fitBrick(int x, int y, int w, int h)
  {
    //Test if a brick of width w and height h fits if its top left corner is placed at position (x, y)
    //Won't fit if the brick is out of boundary
    if (x + w - 1 >= width || y + h - 1 >= height) {
      return false;
    }
    //Won't fit if the available units count is smaller than size of brick
    int test = 0;
    for (int i = x; i < x + w; i++) {
      for (int j = y; j < y + h; j++) {
        test += map[i][j] ? 1 : 0;
      }
    }
    if (test < w * h) {
      return false;
    }
    //Update map, sum, and result array
    for (int i = x; i <= x + w - 1; i++) {
      for (int j = y; j <= y + h - 1; j++) {
        map[i][j] = false;
        result[i][j] = total;
      }
    }
    total++;
    curves.Add(Curve.CreateInterpolatedCurve(new List<Point3d>(){
        getCoord(x, y),
        getCoord(x + w, y),
        getCoord(x + w, y + h),
        getCoord(x, y + h),
        getCoord(x, y)
        }, 1)
      );
    return true;
  }

  private Point3d getCoord(int x, int y) {
    return new Point3d(minX + x * gridSize - gridSize / 2, minY + y * gridSize - gridSize / 2, 0);
  }

  private int nonUniformRand(int n) {
    double max = Math.Pow(n, grad + 1) / (grad + 1);
    double pick = max * rnd.NextDouble();
    double x = Math.Pow(pick * (grad + 1), 1 / (grad + 1));
    return (int) Math.Floor(n - x);
  }
# ---------- end panelizationpercentage ----------
# This is the gene pool version of tiling algorithm with gradient effect, where each gene determines the percentage of area that the corresponding tile type occopies.
# 
# The direction of gradient effect will be along Y axis of the point grid.
# This is a version implemented with prefix array
panelizationpercentage_2 = CSharpScript()  # -> Result, Leftovers, Debug; inputs ModuleDimensions: list of String, ModulePercentages: list of Double, GridSize: Double, PointGrid: list of Point3d, Seed: Int32, FreeOrientation: Boolean, Gradient: Double; disabled
# ---------- panelizationpercentage_2: C# ----------
    rnd = new Random(Seed);
    moduleDimensions = ModuleDimensions;
    modulePercentages = ModulePercentages;
    gridSize = GridSize;
    pointGrid = PointGrid;
    freeOrientation = FreeOrientation;
    grad = Gradient;
    debug = new List<string>();

    initializeArrays();

    convertGrid();
    calculateOptions();
    calculatePrefixSum();
    initializePositionQueue();
    process();

    List<string> leftovers = new List<string>();
    for (int i = 0; i < options.Count - 1; i++) {
      leftovers.Add(options[i].n + " pieces remaining for " + options[i].w + " x " + options[i].h);
    }

    Result = curves;
    Leftovers = leftovers;
    Debug = debug;
# ---------- panelizationpercentage_2: C# additional code ----------
  static Random rnd = new Random(5000);

  //Input info
  private List<string> moduleDimensions;
  private List<double> modulePercentages;
  private double gridSize;
  private List<Point3d> pointGrid;
  private bool freeOrientation;
  private double grad;

  //Dimension of wall
  private int width;
  private int height;
  //Dimension in real coordinates
  private double minX;
  private double minY;
  private double maxX;
  private double maxY;
  //Whether a unit has been covered
  private List<List<bool>> map = new List<List<bool>>();
  //Prefix sum of uncovered unit count
  private List<List<int>> sum = new List<List<int>>();
  //Result denoted by #option for debug
  private List<List<int>> result = new List<List<int>>();
  //Queue storing available positions for process
  private Queue<Position> available = new Queue<Position>();
  //Brick option (width, height, count)
  private List<Option> options = new List<Option>();
  //Final curves
  private List<Curve> curves = new List<Curve>();
  private int total = 1;
  public List<string> debug;

  public class Option {
    public int w;
    public int h;
    public int n;
    public Option(int w, int h) {
      this.w = w;
      this.h = h;
      this.n = 0;
    }
    public Option(int w, int h, int n) {
      this.w = w;
      this.h = h;
      this.n = n;
    }
    public void rotate() {
      int t = w;
      w = h;
      h = t;
    }
  }
  public class Position {
    public int x;
    public int y;
    public Position(int x, int y) {
      this.x = x;
      this.y = y;
    }
  }

  private void initializeArrays() {
    map = new List<List<bool>>();
    sum = new List<List<int>>();
    result = new List<List<int>>();
    available = new Queue<Position>();
    options = new List<Option>();
    curves = new List<Curve>();
  }

  private void convertGrid() {
    
    minX = pointGrid.Min(p => p.X);
    maxX = pointGrid.Max(p => p.X);
    minY = pointGrid.Min(p => p.Y);
    maxY = pointGrid.Max(p => p.Y);
    width = (int) Math.Round((maxX - minX) / gridSize) + 1;
    height = (int) Math.Round((maxY - minY) / gridSize) + 1;
    
    for (int i = 0; i < width; i++)
    {
      map.Add(new List<bool>());
      sum.Add(new List<int>());
      result.Add(new List<int>());
      for (int j = 0; j < height; j++)
      {
        map[i].Add(false);
        sum[i].Add(0);
        result[i].Add(0);
      }
    }
    foreach (Point3d p in pointGrid) {
      map[(int) Math.Round((p.X - minX) / gridSize)][(int) Math.Round((p.Y - minY) / gridSize)] = true;
    }
      
  }

  private void calculateOptions() {
    //Calculate brick counts by area if not given
    options = new List<Option>();
    foreach (string optionString in moduleDimensions) {
      string[] optionDim = optionString.Split(' ');
      options.Add(new Option(Int32.Parse(optionDim[0]), Int32.Parse(optionDim[1])));
    }
    if (modulePercentages == null || modulePercentages.Count < moduleDimensions.Count) {
      for (int i = 0;i < moduleDimensions.Count;i++) {
        modulePercentages.Add(1);
      }
    }
    int totalArea = width * height;
    for (int i = 0; i < options.Count;i++) {
      options[i].n = (int)(totalArea * 0.96 * modulePercentages[i] / modulePercentages.Sum() / (options[i].w * options[i].h));
    }
    options.Sort((x, y) => y.w * y.h - x.w * x.h);
    options.Add(new Option(1, 1, 2147483647));
  }

  private void calculatePrefixSum() {
    for (int i = 0; i < width; i++) {
      for (int j = 0; j < height; j++) {
        sum[i][j] = map[i][j] ? 1 : 0;
        sum[i][j] += i > 0 ? sum[i - 1][j] : 0;
        sum[i][j] += j > 0 ? sum[i][j - 1] : 0;
        sum[i][j] -= i > 0 && j > 0 ? sum[i - 1][j - 1] : 0;
      }
    }
  }

  private void initializePositionQueue() {
    List <Position> positions = new List<Position>();
    for (int i = 0; i < height; i++) {
      for (int j = 0; j < width; j++) {
        if (map[j][i]) {
          positions.Add(new Position(j, i));
        }
      }
    }
    positions = positions.OrderBy(p => p.y).ToList();

    // Shuffle the available positions;
    for (int i = 0; i < positions.Count - 2; i++) {
      int j = i + nonUniformRand(positions.Count - i);
      Position t = positions[j];
      positions[j] = positions[i];
      positions[i] = t;
    }
    for (int i = 0;i < positions.Count;i++) {
      available.Enqueue(positions[i]);
    }
  }

  private void process() {
    for (int currentOption = 0; currentOption < options.Count; currentOption++) {
      int availableCount = available.Count;
      //For each brick option, only need to test each position once
      for (int t = 0; t < availableCount && options[currentOption].n > 0; t++) {
        Position testPosition = available.Dequeue();
        //Dispose the position if it's already covered
        if (map[testPosition.x][testPosition.y]) {
          if (freeOrientation && rnd.Next() % 2 == 0) {
            options[currentOption].rotate();
          }
          if (fitBrick(testPosition.x, testPosition.y, options[currentOption].w, options[currentOption].h)) {
            options[currentOption].n--;
          }
          else if (freeOrientation && fitBrick(testPosition.x, testPosition.y, options[currentOption].h, options[currentOption].w)) {
            options[currentOption].n--;
          }
          else {
            available.Enqueue(testPosition);
          }
        }
      }
    }
  }

  private bool fitBrick(int x, int y, int w, int h)
  {
    //Test if a brick of width w and height h fits if its top left corner is placed at position (x, y)
    //Won't fit if the brick is out of boundary
    if (x + w - 1 >= width || y + h - 1 >= height) {
      return false;
    }
    //Won't fit if the available units count is smaller than size of brick
    int test = x > 0 && y > 0 ? sum[x - 1][y - 1] : 0;
    test -= x + w - 1 < width && y > 0 ? sum[x + w - 1][y - 1] : 0;
    test -= y + h - 1 < height && x > 0 ? sum[x - 1][y + h - 1] : 0;
    test += x + w - 1 < width && y + h - 1 < height ? sum[x + w - 1][y + h - 1] : 0;
    if (test < w * h) {
      return false;
    }
    //Update map, sum, and result array
    for (int i = x; i <= x + w - 1; i++) {
      for (int j = y; j <= y + h - 1; j++) {
        map[i][j] = false;
        result[i][j] = total;
      }
    }
    total++;
    for (int i = x; i < width; i++) {
      for (int j = y; j < height; j++) {
        sum[i][j] -= (i >= x + w - 1 ? w : i - x + 1) * (j >= y + h - 1 ? h : j - y + 1);
      }
    }
    curves.Add(Curve.CreateInterpolatedCurve(new List<Point3d>(){
      getCoord(x, y),
      getCoord(x + w, y),
      getCoord(x + w, y + h),
      getCoord(x, y + h),
      getCoord(x, y)
      }, 1)
    );
    return true;
  }

  private Point3d getCoord(int x, int y) {
    return new Point3d(minX + x * gridSize - gridSize / 2, minY + y * gridSize - gridSize / 2, 0);
  }

  private int nonUniformRand(int n) {
    double max = Math.Pow(n, grad + 1) / (grad + 1);
    double pick = max * ((rnd.Next() % 1000000) / 1000000.0);
    double x = Math.Pow(pick * (grad + 1), 1 / (grad + 1));
    return (int) Math.Floor(n - x);
  }
# ---------- end panelizationpercentage_2 ----------
# This part generates tile layout on grid with given unit length and tile dimensions.
# 
# The grid must align with XY-plane's grid. And the result will be tile outlines on XY-plane.
panelization = CSharpScript(
    ModuleDimensions=module_types,
    ModuleCounts=module_counts,
    GridSize=grid_size,
    PointGrid=gridgenerator.centers,
    FreeOrientation=brick_orientation_landscape_portrait)  # -> Result, TotalUnfilledCells, TotalLeftoverCount, LeftoverCounts, LeftoverPercentages, SortedTypes, Debug; inputs ModuleDimensions: list of String, ModuleCounts: list of Int32, GridSize: Double, PointGrid: tree of Point3d, Seed: Int32, FreeOrientation: Boolean
# ---------- panelization: C# usings ----------
using System.Linq;
using System.Threading;
using System.Threading.Tasks;
using System.Collections.Concurrent;
# ---------- panelization: C# ----------
   
    rnd = new Random(Seed);
    moduleDimensions = ModuleDimensions;
    moduleCounts = ModuleCounts;
    gridSize = GridSize;
    pointGrid = PointGrid;
    freeOrientation = FreeOrientation;
    debug = new List<string>();

    initializeArrays();
    convertGrid();
    calculateOptions();
    initializePositionQueue();
    process();

    List<int> leftoverCounts = new List<int>();
    List<double> leftoverPercentages = new List<double>();
    List<string> sortedTypes = new List<string>();
    for (int i = 0; i < options.Count - 1; i++) {
      leftoverCounts.Add(options[i].n);
      double p = Math.Round(100 * (double) options[i].n / (double) options[i].given, 1);
      leftoverPercentages.Add(p);
      sortedTypes.Add(options[i].w + " x " + options[i].h);
    }

    Result = curves;
    TotalUnfilledCells = bigNum - options[options.Count - 1].n;
    TotalLeftoverCount = leftoverCounts.Sum();
    LeftoverCounts = leftoverCounts;
    LeftoverPercentages = leftoverPercentages;
    SortedTypes = sortedTypes;
    Debug = debug;
# ---------- panelization: C# additional code ----------
  static Random rnd = new Random(5000);

  //Can you make all the properties name CamelCase

  //Input info
  private List<string> moduleDimensions;
  private List<int> moduleCounts;
  private double gridSize;
  private DataTree<Point3d> pointGrid;
  private bool freeOrientation;

  //Num of surfaces
  private int surfNum;
  //Dimension of wall
  private List<int> width = new List<int>();
  private List<int> height = new List<int>();
  //Dimension in real coordinates
  private List<double> minX = new List<double>();
  private List<double> minY = new List<double>();
  private List<double> maxX = new List<double>();
  private List<double> maxY = new List<double>();
  //Whether a unit has been covered
  private List<List<List<bool>>> map = new List<List<List<bool>>>();
  //Queue storing available positions for process
  private Queue<Position> available = new Queue<Position>();
  //Brick option (width, height, count)
  private List<Option> options = new List<Option>();
  //Final curves
  private DataTree<object> curves = new DataTree<object>();

  public List<string> debug;

  private const int bigNum = 2147483647;

  public class Option {
    public int w;
    public int h;
    public int n; //count of that option
    public int given; //given count of that option
    public Option(int w, int h) {
      this.w = w;
      this.h = h;
      this.n = 0;
    }
    public Option(int w, int h, int n) {
      this.w = w;
      this.h = h;
      this.n = n;
      this.given = n;
    }
    public void rotate() {
      int t = w;
      w = h;
      h = t;
    }
  }
  public class Position {
    //Denoting sth surface
    public int s;
    public int x;
    public int y;
    public Position(int s, int x, int y) {
      this.s = s;
      this.x = x;
      this.y = y;
    }
  }

  private void initializeArrays() {
    width = new List<int>();
    height = new List<int>();
    minX = new List<double>();
    minY = new List<double>();
    maxX = new List<double>();
    maxY = new List<double>();
    map = new List<List<List<bool>>>();
    available = new Queue<Position>();
    options = new List<Option>();
    curves = new DataTree<object>();
  }

  private void convertGrid() {
    //Convert point grid to rasterized arrays of booleans

    //Caculate number of valid surfaces - valid number of grid
    surfNum = pointGrid.BranchCount;
    int invalidCount = 0;
    for (int s = 0; s < surfNum; s++){
      List<Point3d> pts = pointGrid.Branches[s];
      if (pts.Count == 0) {
        invalidCount++;
        continue;
      }
      int si = s - invalidCount;

      //Calculate grid width and height
      minX.Add(pts.Min(p => p.X));
      maxX.Add(pts.Max(p => p.X));
      minY.Add(pts.Min(p => p.Y));
      maxY.Add(pts.Max(p => p.Y));
      width.Add((int) Math.Round((maxX[si] - minX[si]) / gridSize) + 1);
      height.Add((int) Math.Round((maxY[si] - minY[si]) / gridSize) + 1);

      //generate rasterized array of booleans of false
      map.Add(new List<List<bool>>());
      for (int i = 0; i < width[si]; i++)
      {
        map[si].Add(new List<bool>());
        for (int j = 0; j < height[si]; j++)
        {
          map[si][i].Add(false);
        }
      }

      //if point exist in that position. convert false to true
      foreach (Point3d p in pts) {
        map[si][(int) Math.Round((p.X - minX[si]) / gridSize)][(int) Math.Round((p.Y - minY[si]) / gridSize)] = true;
      }
    }
    surfNum -= invalidCount;
  }

  private void calculateOptions() {
    //Calculate brick counts by area if not given

    //Initialize and populate all options
    options = new List<Option>();
    foreach (string optionString in moduleDimensions) {
      string[] optionDim = optionString.Split(' ');
      options.Add(new Option(Int32.Parse(optionDim[0]), Int32.Parse(optionDim[1])));
    }

    // use given count if provided, else the count is surfaceArea/(options.Count?)/optionsArea?
    if (moduleCounts != null && moduleCounts.Count >= moduleDimensions.Count) {
      for (int i = 0;i < moduleDimensions.Count;i++) {
        options[i].n = moduleCounts[i];
        options[i].given = options[i].n;
      }
    }
    else {
      int totalArea = 0;
      for (int s = 0; s < surfNum; s++) {
        totalArea += width[s] * height[s];
      }
      for (int i = 0; i < options.Count;i++) {
        options[i].n = totalArea / options.Count / (options[i].w * options[i].h);
        options[i].given = options[i].n;
      }
    }
    options.Sort((x, y) => y.w * y.h - x.w * x.h); //sort from bottom left? 
    options.Add(new Option(1, 1, bigNum)); //???
  }

  private void initializePositionQueue() {
    //populate the existing position
    List <Position> positions = new List<Position>();
    for (int s = 0;s < surfNum;s++) {
      for (int i = 0; i < width[s]; i++) {
        for (int j = 0; j < height[s]; j++) {
          if (map[s][i][j]) {
            positions.Add(new Position(s, i, j));
          }
        }
      }
    }
    //Then shuffle the available positions;
    for (int i = 0; i < positions.Count - 2; i++) {
      int j = i + rnd.Next() % (positions.Count - i);
      Position t = positions[j];
      positions[j] = positions[i];
      positions[i] = t;
    }
    for (int i = 0;i < positions.Count;i++) {
      available.Enqueue(positions[i]);
    }
  }

  private void process() {
    for (int currentOption = 0; currentOption < options.Count; currentOption++) {
      int availableCount = available.Count;
      //For each brick option, only need to test each position once
      for (int t = 0; t < availableCount && options[currentOption].n > 0; t++) {
        Position testPosition = available.Dequeue();         //Dispose the position if it's already covered ???

        if (map[testPosition.s][testPosition.x][testPosition.y]) { // if position is available
          if (freeOrientation && rnd.Next() % 2 == 0) { //rotate brick at random.
            options[currentOption].rotate();
          }
          if (fitBrick(testPosition.s, testPosition.x, testPosition.y, options[currentOption].w, options[currentOption].h)) { //if can fit original brick
            options[currentOption].n--;
          }
          else if (freeOrientation && fitBrick(testPosition.s, testPosition.x, testPosition.y, options[currentOption].h, options[currentOption].w)) { //if can fit rotated brick
            options[currentOption].n--;
          }
          else { //if cannot fit at all, add back the position
            available.Enqueue(testPosition);
          }
        }
      }
    } 
  }

  private bool fitBrick(int s, int x, int y, int w, int h)
  {
    //Test if a brick of width w and height h fits if its bottom right corner is placed at position (x, y)
    //Won't fit if the brick is out of boundary
    if (x + w - 1 >= width[s] || y + h - 1 >= height[s]) {
      return false;
    }
    //Won't fit if the available units count is smaller than size of brick
    int test = 0;
    for (int i = x; i < x + w; i++) {
      for (int j = y; j < y + h; j++) {
        test += map[s][i][j] ? 1 : 0;
      }
    }
    if (test < w * h) {
      return false;
    }
    //Update map - for position that is inside the brick. that position considered unavailable.
    for (int i = x; i <= x + w - 1; i++) {
      for (int j = y; j <= y + h - 1; j++) {
        map[s][i][j] = false;
      }
    }
    curves.Add(Curve.CreateInterpolatedCurve(new List<Point3d>(){
        getCoord(s, x, y),
        getCoord(s, x + w, y),
        getCoord(s, x + w, y + h),
        getCoord(s, x, y + h),
        getCoord(s, x, y)
        }, 1),
      new GH_Path(s)
      );
    return true;
  }

  private Point3d getCoord(int s, int x, int y) {
    return new Point3d(minX[s] + x * gridSize - gridSize / 2, minY[s] + y * gridSize - gridSize / 2, 0);
  }
# ---------- end panelization ----------
curve = Curve(panelizationpercentage.Result)
sorted_types = Panel(panelization.SortedTypes)
leftover_percentages_by_types = Panel(panelization.LeftoverPercentages)
leftover_counts_by_types = Panel(panelization.LeftoverCounts)
total_unfilled_cells = Panel(panelization.TotalUnfilledCells)
total_leftover_count = Panel(panelization.TotalLeftoverCount)
srf = Surface(simplify(graft(debrep.Faces)))
# This part put tile outlines back to original surfaces, trim away the extra area, and generate thickness.
# 
# Sometimes splitting may fail.
tiling = Tiling(srf=srf, crv=panelization.Result, source_plane=gridgenerator.source_plane_2, target_plane=gridgenerator.target_plane_2)  # -> flatten(F)

# ==== cluster GridGenerator
surface = ClusterInput()
gridsize = ClusterInput()
surface_2 = Surface(surface)
md_slider = MDSlider(SliderMode=0, slider_value=Point(0.5, 0.5, 0.5), x_domain=Domain(0, 1), y_domain=Domain(0, 1), z_domain=Domain(0, 1))
evaluate_surface = EvaluateSurface(Surface=reparameterize(surface_2), Point=md_slider)  # -> Point, Normal, UDirection, VDirection, Frame
xy = XYPlane(Origin=Point(0, 0, 0))
orient = Orient(Geometry=surface_2, Source=evaluate_surface.Frame, Target=xy)  # -> Geometry, Transform
brep_edges = BrepEdges(Brep=orient.Geometry)  # -> Naked, Interior, NonManifold
join_curves = JoinCurves(Curves=brep_edges.Naked, Preserve=False)  # -> simplify(Curves)
eps = Number(0.001)
gridsize_2 = Number(gridsize)
target_plane = Plane(evaluate_surface.Frame)
source_plane = Plane(xy)
source_plane_2 = ClusterOutput(source_plane)
target_plane_2 = ClusterOutput(target_plane)

# ---- group: Scale up the bounding box to smallest unit length
brec = BoundingRectangle(Geometry=join_curves, Plane=PlaneXY(0, 0, 0), Axis=0, Slide=0, Union=True)  # -> simplify(flatten(Bounding)), DimensionX, DimensionY
gridsize_3 = Number(gridsize)
division = Division(A=brec.DimensionX, B=gridsize_3)
division_2 = Division(A=brec.DimensionY, B=gridsize_3)

# ----
subtraction = Subtraction(A=division, B=eps)
subtraction_2 = Subtraction(A=division_2, B=eps)

# ---- group: Scale up the bounding box to smallest unit length (continued)
round = Round(Number=subtraction)  # -> Nearest, Floor, Ceiling
round_2 = Round(Number=subtraction_2)  # -> Nearest, Floor, Ceiling
multiplication = Multiplication(A=round.Ceiling, B=gridsize_3)
multiplication_2 = Multiplication(A=round_2.Ceiling, B=gridsize_3)
division_3 = Division(A=multiplication, B=brec.DimensionX)  # -> flatten(Result)
division_4 = Division(A=multiplication_2, B=brec.DimensionY)  # -> flatten(Result)
scale_nu = ScaleNU(Geometry=brec.Bounding, Plane=PlaneXY(0, 0, 0), ScaleX=division_3, ScaleY=division_4, ScaleZ=1)  # -> Geometry, Transform

# ----
panel = Panel(round.Ceiling)
rectangle_grid = RectangleGrid(Rectangle=scale_nu.Geometry, Size=gridsize_2, Compact=False, FitSize=False)  # -> Points, U, V
list_length = ListLength(List=rectangle_grid.U)
shift_paths = ShiftPaths(Data=list_length, Offset=-1)
shift_paths_2 = ShiftPaths(Data=rectangle_grid.Points, Offset=-1)
tree_statistics = TreeStatistics(Tree=shift_paths)  # -> Paths, Length, Count
list_item = ListItem(List=shift_paths, Index=0, Wrap=True)
mesh_frompoints = MeshFromPoints(Points=shift_paths_2, UDirection=simplify(graft(tree_statistics.Length)), VDirection=list_item)
face_normals = FaceNormals(Mesh=mesh_frompoints)  # -> simplify(Centers), Normals
centers = ClusterOutput(face_normals.Centers)

# ==== cluster Tiling
srf = ClusterInput()
crv = ClusterInput()
source_plane = ClusterInput()
target_plane = ClusterInput()

crv_2 = Curve(crv)
source_plane_2 = Plane(source_plane)
target_plane_2 = Plane(target_plane)
srf_2 = Surface(srf)
orient = Orient(Geometry=crv_2, Source=simplify(source_plane_2), Target=simplify(target_plane_2))  # -> Geometry, Transform
explode = Explode(Curve=orient.Geometry, Recursive=True)  # -> Segments, Vertices
shift = ShiftPaths(Data=explode.Segments, Offset=-1)
srfsplit = SurfaceSplit(Surface=srf_2, Curves=shift)  # -> simplify(Fragments)

panel = Panel(shift)
F = ClusterOutput(srfsplit)
