# Grasshopper definition ModuleCount.gh (Grasshopper 1.0.7)

example_input = Curve([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])
brick_orientation_landscape_portrait = BooleanToggle(True)
pipeline = GeometryPipeline(
    GroupByLayer=False,
    GroupByType=False,
    IncludeHidden=True,
    IncludeLocked=True,
    LayerFilter="ToCount",
    NameFilter="*",
    SublayerFiltering=True,
    TypeFilter=4)
panel = Panel(pipeline)
# The script estimates the unit length by bounding boxes of given curves on XY plane. Make sure to orient them correctly.
# 
# Remember to adjust the precision, non-integer dimensions will be rounded to that number of decimal places
# 
# There's chance this script failing due to accuracy of floating point representation, for example getting 0.74999999.
precision = Slider(2, range=0..5)
moduleimport = CSharpScript(Curves=flatten(pipeline), Precision=precision, FreeOrientation=brick_orientation_landscape_portrait)  # -> ModuleDimensions, ModuleCounts, UnitLength; inputs Curves: list of Curve, Precision: Int32, FreeOrientation: Boolean
# ---------- moduleimport: C# usings ----------
using System.Linq;
# ---------- moduleimport: C# ----------
    debug = new List<string>();

    List<Dimension> dimensions = Curves.Select(c => new Dimension(
      (int)(Math.Round(c.GetBoundingBox(true).Max.X - c.GetBoundingBox(true).Min.X, Precision) * Math.Pow(10, Precision)),
      (int)(Math.Round(c.GetBoundingBox(true).Max.Y - c.GetBoundingBox(true).Min.Y, Precision) * Math.Pow(10, Precision)),
      FreeOrientation
    )).ToList();

    HashSet<int> lengths = new HashSet<int>();
    lengths.UnionWith(dimensions.Select(d => d.w));
    lengths.UnionWith(dimensions.Select(d => d.h));
    int gridSize = getGCD(lengths.ToList());
    
    foreach (Dimension dimension in dimensions) {
      dimension.w /= gridSize;
      dimension.h /= gridSize;
    }

    HashSet<Dimension> dimensionSet = new HashSet<Dimension>();
    dimensionSet.UnionWith(dimensions);
    List<Dimension> dimensionOptions = dimensionSet.ToList();
    dimensionOptions.Sort((x, y) => (x.w * x.h - y.w * y.h));

    List<string> moduleDimensions = dimensionOptions.Select(d => d.w + " " + d.h).ToList();

    List<int> moduleCounts = new List<int>();
    for (int i = 0; i < dimensionOptions.Count; i++) {
      moduleCounts.Add(0);
      foreach(Dimension dimension in dimensions) {
        if (dimension.Equals(dimensionOptions[i])) {
          moduleCounts[i]++;
        }
      }
    }

    ModuleDimensions = moduleDimensions;
    ModuleCounts = moduleCounts;
    UnitLength = gridSize / Math.Pow(10, Precision);
# ---------- moduleimport: C# additional code ----------
  private List<string> debug;

  private class Dimension {
    public int w;
    public int h;
    public Dimension(int w, int h, bool freeOrientation) {
      if (freeOrientation) {
        this.w = (w < h ? w : h);
        this.h = (w > h ? w : h);
      }
      else {
        this.w = w;
        this.h = h;
      }
    }
    public override string ToString() {
      return w + " " + h;
    }
    public override bool Equals(object obj) {
      return this.Equals(obj as Dimension);
    }
    public bool Equals(Dimension other) {
      return (Math.Abs(w - other.w) == 0 && Math.Abs(h - other.h) == 0);
    }
    public override int GetHashCode() {
      return 0;
    }
  }

  private int GCD(int a, int b) {
    if (a < b) {
      int t = b;
      b = a;
      a = t;
    }
    if (b == 0) {
      return a;
    }
    else {
      return GCD(b, a % b);
    }
  }

  private int getGCD(List<int> list) {
    int result = list.First();
    for (int i=1;i<list.Count;i++) {
      result = GCD(result, list[i]);
    }
    return result;
  }
# ---------- end moduleimport ----------
dimensions = Panel(moduleimport.ModuleDimensions)
counts = Panel(moduleimport.ModuleCounts)
unit_length = Panel(moduleimport.UnitLength)
