# Grasshopper definition 230810_GenericCounting.gh (Grasshopper 1.0.7)

pipeline = GeometryPipeline(
    GroupByLayer=False,
    GroupByType=False,
    IncludeHidden=True,
    IncludeLocked=True,
    LayerFilter="ToCount",
    NameFilter="*",
    SublayerFiltering=True,
    TypeFilter=1073741848)
pipeline_2 = GeometryPipeline(
    GroupByLayer=False,
    GroupByType=False,
    IncludeHidden=True,
    IncludeLocked=True,
    LayerFilter="OriginalTiles",
    NameFilter="*",
    SublayerFiltering=True,
    TypeFilter=1073741848)
result = Brep(flatten(pipeline))
original_tiles = Brep(pipeline_2)
identifiergenerator = IdentifierGenerator(breps=result)  # -> shapeidentifiers, simplify(mirroridentifiers)
identifiergenerator_2 = IdentifierGenerator(breps=original_tiles)  # -> shapeidentifiers, simplify(mirroridentifiers)
merge = Merge(Data1=identifiergenerator.shapeidentifiers, Data2=identifiergenerator.mirroridentifiers)  # -> simplify(Result)
merge_2 = Merge(Data1=identifiergenerator_2.shapeidentifiers, Data2=identifiergenerator_2.mirroridentifiers)  # -> simplify(Result)
hashencoder = CSharpScript(Identifiers=merge)  # -> flatten(Keys); inputs Identifiers: list of Double
# ---------- hashencoder: C# usings ----------
using System.Security.Cryptography;
using System.Linq;
using System.Text;
# ---------- hashencoder: C# ----------
    string message = "";
    for (int i = 0;i < Identifiers.Count;i++) {
      message += GetInt(Identifiers[i]).ToString();
    }
    Keys = ComputeSha256Hash(message);
# ---------- hashencoder: C# additional code ----------
  private int GetInt(double x) {
    return ((int) Math.Round(x * 100000)) / 10;
  }

  private string ComputeSha256Hash(string rawData)
  {
    // Create a SHA256
    using (SHA256 sha256Hash = SHA256.Create())
    {
      // ComputeHash - returns byte array
      byte[] bytes = sha256Hash.ComputeHash(Encoding.UTF8.GetBytes(rawData));

      // Convert byte array to a string
      StringBuilder builder = new StringBuilder();
      for (int i = 0; i < bytes.Length; i++)
      {
        builder.Append(bytes[i].ToString("x2"));
      }
      return builder.ToString();
    }
  }
# ---------- end hashencoder ----------
hashencoder_2 = CSharpScript(Identifiers=merge_2)  # -> flatten(Keys); inputs Identifiers: list of Double; same code as hashencoder
counter = CSharpScript(
    HashValues=hashencoder,
    OriginalTileHashValues=hashencoder_2,
    QueryOriginalType=Slider(25, range=0..25),
    QueryExtraType=Slider(72, range=0..100))  # -> Count, AllOriginalTiles, AllExtraTiles, QueryOriginalResults, QueryExtraResults; inputs HashValues: list of String, OriginalTileHashValues: list of String, QueryOriginalType: Int32, QueryExtraType: Int32
# ---------- counter: C# ----------
    int total = HashValues.Count;
    HashSet<string> set = new HashSet<string>();
    for (int i = 0;i < total;i++) {
      set.Add(HashValues[i]);
    }
    Count = set.Count;


    List<string> setList = set.ToList();
    List<string> extraTileHashValues = new List<string>();
    DataTree<object> allOriginalTiles = new DataTree<object>();
    DataTree<object> allExtraTiles = new DataTree<object>();


    if (OriginalTileHashValues != null && OriginalTileHashValues.Count > 0) {
      foreach (string key in setList) {
        if (!OriginalTileHashValues.Contains(key)) {
          extraTileHashValues.Add(key);
        }
      }

      QueryOriginalType %= OriginalTileHashValues.Count;
      List<int> queryOriginalResults = new List<int>();
      for (int i = 0;i < total;i++) {
        if (OriginalTileHashValues.Contains(HashValues[i])) {
          allOriginalTiles.Add(i, new GH_Path(OriginalTileHashValues.IndexOf(HashValues[i])));
        }
        if (HashValues[i] == OriginalTileHashValues[QueryOriginalType]) {
          queryOriginalResults.Add(i);
        }
      }
      QueryOriginalResults = queryOriginalResults;
    }
    else {
      extraTileHashValues = setList;
    }

    QueryExtraType %= set.Count;
    List<int> queryExtraResults = new List<int>();
    for (int i = 0;i < total;i++) {
      if (extraTileHashValues.Contains(HashValues[i])) {
        allExtraTiles.Add(i, new GH_Path(extraTileHashValues.IndexOf(HashValues[i])));
      }
      if (HashValues[i] == extraTileHashValues[QueryExtraType]) {
        queryExtraResults.Add(i);
      }
    }
    QueryExtraResults = queryExtraResults;

    AllOriginalTiles = allOriginalTiles;
    AllExtraTiles = allExtraTiles;
# ---------- end counter ----------
# The output of the counter will be indices, so make sure the order/structure of all breps is not changed so that the component selects correct breps.
brep = Brep(result)
unique_tiles = Panel(counter.Count)

lng = ListLength(List=counter.AllExtraTiles)  # -> flatten(Length)
lng_2 = ListLength(List=flatten(counter.AllExtraTiles))
lng_3 = ListLength(List=counter.AllOriginalTiles)  # -> flatten(Length)
lng_4 = ListLength(List=flatten(counter.AllOriginalTiles))
count_per_original_types = Panel(lng_3)
original_tiles_2 = Panel(lng_4)
extra_tiles = Panel(lng_2)
count_per_extra_types = Panel(lng)
lng_5 = ListLength(List=count_per_original_types)
lng_6 = ListLength(List=count_per_extra_types)
unique_types = Panel(lng_5)
unique_types_2 = Panel(lng_6)

item = ListItem(List=brep, Index=counter.AllOriginalTiles, Wrap=True)
item_2 = ListItem(List=brep, Index=counter.AllExtraTiles, Wrap=True)
item_3 = ListItem(List=brep, Index=counter.QueryOriginalResults, Wrap=True)
item_4 = ListItem(List=brep, Index=counter.QueryExtraResults, Wrap=True)
preview = CustomPreview(Geometry=item, Material=ColourSwatch(SwatchColor=RGB(255, 255, 255)))
preview_2 = CustomPreview(Geometry=item_2, Material=ColourSwatch(SwatchColor=RGB(129, 199, 212)))
preview_3 = CustomPreview(Geometry=item_3, Material=ColourSwatch(SwatchColor=RGB(129, 0, 212)))
preview_4 = CustomPreview(Geometry=item_4, Material=ColourSwatch(SwatchColor=RGB(255, 0, 0)))

# ==== cluster IdentifierGenerator
breps = ClusterInput()
debrep = DeconstructBrep(Breps=breps)  # -> Faces, Edges, Vertices
area = Area(Geometry=debrep.Faces)  # -> Area, simplify(Centroid)
curvepoint = PointOnCurve(debrep.Edges, parameter=0.5)
merge = Merge(Data1=curvepoint, Data2=debrep.Vertices)
cullpt = CullDuplicates(Points=merge, Tolerance=0.0001, CullMode=3)  # -> simplify(Points), Indices, Valence
encoder = CSharpScript(Points=cullpt.Points, Centroids=area.Centroid, EnableSHA=Toggle(True))  # -> simplify(ShapeIdentifiers), simplify(MirrorIdentifiers); inputs Points: list of Point3d, Centroids: list of Point3d, EnableSHA: Boolean
# ---------- encoder: C# usings ----------
using System.Linq;
# ---------- encoder: C# ----------
    Points = Points.OrderBy(p => getPointSortKey(p, Points)).ToList();

    //All Points' distances to each other
    List<double> shapeIdentifiers = new List<double>();
    for (int i = 0;i < Points.Count - 1;i++) {
      for (int j = i + 1;j < Points.Count;j++) {
        shapeIdentifiers.Add(Points[i].DistanceTo(Points[j]));
      }
    }
    shapeIdentifiers.Sort();
    ShapeIdentifiers = shapeIdentifiers;

    //If consists of multiple pieces
    List<double> mirrorIdentifiers = new List<double>();
    if (Centroids.Count > 1) {
      Centroids.OrderBy(p => getPointSortKey(p, Points));
      Vector3d v1 = Centroids.Last() - Points.First();
      Vector3d v2 = Centroids.First() - Points.First();
      Vector3d cp = Vector3d.CrossProduct(v1, v2);
      Point3d rp = Points.First() + cp;
      mirrorIdentifiers.AddRange(Points.Select(p => p.DistanceTo(rp)));
      if (Math.Abs(getPointSortKey(Centroids.First(), Points) - getPointSortKey(Centroids.Last(), Points)) < eps) {
        cp = Vector3d.CrossProduct(v2, v1);
        rp = Points.First() + cp;
        mirrorIdentifiers.AddRange(Points.Select(p => p.DistanceTo(rp)));
      }
      mirrorIdentifiers.Sort();
      MirrorIdentifiers = mirrorIdentifiers;
    }
    else {
      MirrorIdentifiers = new List<double>(0);
    }
# ---------- encoder: C# additional code ----------
  private const double eps = 0.00001;

  private double getPointSortKey(Point3d tar, List<Point3d> refs) {
    return refs.Sum(p => tar.DistanceTo(p));
  }
# ---------- end encoder ----------
shapeidentifiers = ClusterOutput(encoder.ShapeIdentifiers)
mirroridentifiers = ClusterOutput(encoder.MirrorIdentifiers)
